# Dynamo custom node AdaptiveComponents.UpdatePts.dyf (Dynamo 1.0.0.1180)
# category: CM
# Update points of adaptive components

adaptiveEls = Input()  # adaptive elements to change
flatten = Flatten(adaptiveEls)
id = Element.Id(flatten)
udpatedPts = Input()  # points to update. Need to be dynamo pts.
code_block = CodeBlock(x=udpatedPts) { x.X+","+x.Y+","+x.Z; }
active = Input()  # active boolean.. will only activate if set true
python_script = Python(IN[0]=id, IN[1]=code_block, IN[2]=active)
# ---------- python_script.python (45 lines) ----------
adptPoints = []
dataEnteringNode = IN

if IN[2]:
	import clr
	
	clr.AddReference('RevitAPI')
	from Autodesk.Revit.DB import *
	
	clr.AddReference("RevitNodes")
	import Revit
	from Revit.Elements import *

	
	# Import DocumentManager
	clr.AddReference("RevitServices")
	import RevitServices
	from RevitServices.Persistence import DocumentManager
	
	

	
	doc = DocumentManager.Instance.CurrentDBDocument
	uiapp = DocumentManager.Instance.CurrentUIApplication
	app = uiapp.Application
	
		
	
	newPts = IN[1]
	for i,elID in enumerate(IN[0]):
		
		element = doc.GetElement(ElementId(elID))
		adptPoints = AdaptiveComponentInstanceUtils.GetInstancePlacementPointElementRefIds(element)
		adptPoints = map(lambda x:  doc.GetElement(x), adptPoints)
		
		if newPts[i]!=None and len(newPts[i])>0: 
			t = Transaction(doc, "Change XYZ")
			t.Start()
			for j,ptEl in enumerate(adptPoints):
				ptDecompose = newPts[i][j].split(",")
				ptEl.Position = XYZ( float(ptDecompose[0]), float(ptDecompose[1]), float(ptDecompose[2]))
			t.Commit()       

#Assign your output to the OUT variable.
OUT = adptPoints
# ----------------------------------------
watch = Watch()
