# Dynamo custom node CurtianPanelPts.dyf (Dynamo 1.2.1.3083)
# category: CM.Core
# Gets vertices of curtian panel

elements = Input()
boundaries = CurtainPanel.Boundaries(elements)
python_script = Python(IN[0]=boundaries)
# ---------- python_script.python (10 lines) ----------
import clr
clr.AddReference('ProtoGeometry')
from Autodesk.DesignScript.Geometry import *
#The inputs to this node will be stored as a list in the IN variables.
dataEnteringNode = IN
OUT = []
for k,v in enumerate(IN[0]):
	OUT.append(v==None)

#Assign your output to the OUT variable.
# ----------------------------------------
filterByBoolMask = List.FilterByBoolMask(list=boundaries, mask=python_script)
patch = Curve.Patch(filterByBoolMask.out)
vertices = Face.Vertices(patch)
pointGeometry = Vertex.PointGeometry(vertices)
code_block = CodeBlock { 1; }
flatten = List.Flatten(list=pointGeometry, amt=code_block)
code_block_2 = CodeBlock(x=boundaries) { 0..Count(x); }
filterByBoolMask_2 = List.FilterByBoolMask(list=code_block_2, mask=python_script)
code_block_3 = CodeBlock { {}; }
replace_nulls_with = Python(IN[0]=filterByBoolMask.in, IN[1]=code_block_3)
# ---------- replace_nulls_with.python (13 lines) ----------
import clr
clr.AddReference('ProtoGeometry')
from Autodesk.DesignScript.Geometry import *
#The inputs to this node will be stored as a list in the IN variables.
dataEnteringNode = IN
OUT = []
for k,v in enumerate(IN[0]):
	if (v==None):
		OUT.append(IN[1])
	else:
		OUT.append(v)

#Assign your output to the OUT variable.
# ----------------------------------------
python_script_2 = Python(IN[0]=flatten, IN[1]=filterByBoolMask_2.out, IN[2]=replace_nulls_with, IN[3]=filterByBoolMask_2.in)
# ---------- python_script_2.python (59 lines) ----------
import clr
clr.AddReference('ProtoGeometry')
from Autodesk.DesignScript.Geometry import *
#The inputs to this node will be stored as a list in the IN variables.
dataEnteringNode = IN


# <------------ LOG STUFF -------------------->#
LOGFILE =  "T:\Malcolm-Chris\REVIT\DYNAMO\log.txt"
RAW_WRITE = True
LOG_ACTIVE = False
def is_array(var):
    return isinstance(var, (list, tuple))

def log(textArr,is_raw=False):
    global LOGFILE,LOG_ACTIVE
    if LOG_ACTIVE:
        filename =  LOGFILE
        if (not is_array(textArr)):
            textArr = [textArr]
        target = open(filename, 'a+')
        target.write("\n")
        for i in textArr:
            if (not is_raw):
                target.write(repr(i))
            else:
                target.write(i)
        target.close()

def clearLog():
    global LOGFILE,LOG_ACTIVE
    if LOG_ACTIVE:
        filename =  LOGFILE
        target = open(filename, 'w+')
        target.write("")
        target.close()
# <------------ LOG STUFF -------------------->#

clearLog()
dic = {}
valSet1 = IN[0]
indexSet1 = IN[1]
valSet2 = IN[2]
indexSet2 = IN[3]


#get in a div
log("indexSet1:", indexSet1)
log("indexSet2:", indexSet2)
for id,index in enumerate(indexSet1):
	dic[index] = valSet1[id]
for id,index in enumerate(indexSet2):
	dic[index] = valSet2[id]

OUT = []
#append to out
log(dic)
for i in range(len(dic.items())): 
	OUT.append(dic[i])
# ----------------------------------------
pts = Output(python_script_2)
code_block_4 = CodeBlock(x=pointGeometry) { Count(x); }
area = Surface.Area(patch)
watch = Watch(filterByBoolMask.out)
watch_2 = Watch(flatten)
watch_3 = Watch(python_script_2)
code_block_5 = CodeBlock(x=filterByBoolMask.in) { (x==null) ? {} : x; }
code_block_6 = CodeBlock {  }
watch_4 = Watch(replace_nulls_with)
